# Grasshopper definition Add.gh (Grasshopper 1.0.8)

number_slider = Slider(8, range=0..10)

# ---- group: RH_IN:y
Y = Integer(number_slider)

# ---- group: RH_IN:x
X = Integer(number_slider)

# ----
addition = Addition(A=X, B=Y)

# ---- group: RH_OUT:res
res = Number(addition)

# ----
panel = Panel(addition)
panel_2 = Panel(res)
